# Dynamo graph 05_Rotulos de perfil.dyn (Dynamo 4.0.2.3852)
# Por assembly: escribe sobre cada viga de las plantas T.A. el nombre de su tipo (acortandolo en la x cuando no entra en el largo de la viga) y pone un Multi-Category Tag sobre cada pieza que este sobre el eje en las elevaciones.

n01_procesar_todos_los_assemblies = BoolSelector(true)  # "01. Procesar TODOS los assemblies"; graph input
n02_filtro_por_nombre_si_todos = StringInput("")  # "02. Filtro por nombre (si TODOS = False)"; graph input
n03_tipo_de_texto_del_rotulo = StringInput("C_TBL_RomanD2.2mm")  # "03. Tipo de texto del rotulo"; graph input
n04_margen_libre_a_cada_lado_del = IntegerSlider(2, range=0..20 step 1)  # "04. Margen libre a cada lado del rotulo (mm de papel)"; graph input
n05_familias_a_no_rotular_parcial = StringInput("GRATING")  # "05. Familias a NO rotular (parcial, comas)"; graph input
n06_rehacer_los_rotulos = BoolSelector(false)  # "06. Rehacer los rotulos existentes"; graph input
n07_tag_de_perfil_en_elevaciones = StringInput("Item_TBL")  # "07. Tag de perfil en elevaciones (vacio = no rotularlas)"; graph input
n08_elevaciones_solo_lo_que_este = IntegerSlider(30, range=0..100 step 1)  # "08. Elevaciones: solo lo que este a menos de (cm) del eje"; graph input
n09_elevaciones_separacion_del = IntegerSlider(2, range=0..100 step 1)  # "09. Elevaciones: separacion del tag a la pieza (mm de papel)"; graph input
py_rotulo_de_perfil_sobre_cada = Python(IN[0]=n01_procesar_todos_los_assemblies, IN[1]=n02_filtro_por_nombre_si_todos, IN[2]=n03_tipo_de_texto_del_rotulo, IN[3]=n04_margen_libre_a_cada_lado_del, IN[4]=n05_familias_a_no_rotular_parcial, IN[5]=n06_rehacer_los_rotulos, IN[6]=n07_tag_de_perfil_en_elevaciones, IN[7]=n08_elevaciones_solo_lo_que_este, IN[8]=n09_elevaciones_separacion_del)  # "PY | Rotulo de perfil sobre cada viga"; PythonNet3
# ---------- py_rotulo_de_perfil_sobre_cada.python (600 lines) ----------
# 05_Rotulos de perfil - ACERO
#
# En las PLANTAS T.A.: escribe sobre cada viga el nombre de su tipo (C20x13,1,
# IN20x35,2, L6,5x4,780...), acortandolo cuando no entra en el largo de la viga.
# En las ELEVACIONES de eje: pone un Multi-Category Tag sobre cada pieza que este
# sobre el eje de la vista, horizontal en las vigas y girado 90 grados en las columnas.
#
# POR QUE TEXTNOTE EN PLANTA Y TAG EN ELEVACION. Un IndependentTag muestra el Type Name
# y la API no deja sobrescribir su texto por instancia, asi que con tags no se puede
# truncar. En planta eso es fatal (el nombre no entra en el largo de la viga y hay que
# cortarlo en la "x"), pero en la elevacion el nombre va completo: ahi no hay nada que
# truncar y conviene el tag de verdad, que es asociativo y se actualiza solo si alguien
# le cambia el perfil a la pieza. Es ademas lo que usa el modelador en su vista de
# referencia (ELEVACION EJE A, id 6154003: 10 tags de la familia Item_TBL, los de las
# columnas con Angle = pi/2).
#
# COMO ACORTA EL MODELADOR. No inventa abreviaturas: corta en la "x", que es lo que
# separa la designacion del perfil del peso en kg/m.
#     C20x13,1   -> C20        IN20x35,2  -> IN20
#     L6,5x4,780 -> L6,5       L8x7,07    -> L8
# El corte es insensible a mayusculas porque en el modelo conviven L8x7,07 y L8X7,07.
#
# COMO SE DECIDE SI CABE. No se estima el ancho de la fuente: se MIDE. Se crea un
# TextNote de prueba por cada texto distinto, se regenera, se lee su bounding box y se
# borra. Con eso el "cabe o no cabe" queda en un if contra el largo de la viga.
#
# Revit 2027 / Dynamo 4 / CPython3
# IN[0] = procesar todos los assemblies (bool)
# IN[1] = filtro por nombre si IN[0] es False (parcial, comas)
# IN[2] = nombre del tipo de texto (el log lista los que hay en el proyecto)
# IN[3] = margen libre a cada lado del rotulo, en mm de papel
# IN[4] = familias a NO rotular (parcial, comas)
# IN[5] = rehacer los rotulos que ya existan (bool)
# IN[6] = tipo de tag para las elevaciones (vacio = no rotular las elevaciones)
# IN[7] = en elevacion solo se rotula lo que este a menos de esto del eje, en cm
# IN[8] = separacion del tag a la pieza en la elevacion, en mm de papel

import math
import clr
clr.AddReference('RevitAPI')
clr.AddReference('RevitServices')
from Autodesk.Revit.DB import (FilteredElementCollector, AssemblyInstance, View, XYZ,
                               ElementId, BuiltInCategory, BuiltInParameter, Element,
                               FamilyInstance, FamilySymbol, Line, Reference,
                               IndependentTag, TagOrientation,
                               TextNote, TextNoteType,
                               TextNoteOptions, HorizontalTextAlignment,
                               FailureProcessingResult, FailureSeverity)
from System.Collections.Generic import List
from RevitServices.Persistence import DocumentManager
from RevitServices.Transactions import TransactionManager

doc = DocumentManager.Instance.CurrentDBDocument

process_all = bool(IN[0])
filter_text = (IN[1] or '').strip()
tipo_pedido = (IN[2] or '').strip()
margen_mm = float(IN[3])
excluidas = [t.strip().lower() for t in (IN[4] or '').split(',') if t.strip()]
rehacer = bool(IN[5])
tag_pedido = (IN[6] or '').strip()
tol_eje_cm = float(IN[7])
sep_tag_mm = float(IN[8])

log = []

SUF_TA = ' - T.A. '
SUF_EJE = ' - EJE '
PIE = 304.8
TOL_PLANTA = 0.0033      # pies (~1 mm): por debajo la viga es un punto en planta

CATS_ROTULABLES = (BuiltInCategory.OST_StructuralFraming,
                   BuiltInCategory.OST_StructuralColumns)


def elem_name(e):
    try:
        return e.Name
    except Exception:
        return Element.Name.__get__(e)


def nombre_tipo(el):
    # el rotulo es el Type Name, que es lo que muestra el tag Multi-Category del modelo
    try:
        s = el.Symbol
        if s is not None:
            return elem_name(s)
    except Exception:
        pass
    try:
        t = doc.GetElement(el.GetTypeId())
        if t is not None:
            return elem_name(t)
    except Exception:
        pass
    return ''


def acortar(nombre):
    # se tira todo lo que va desde la "x" en adelante: es el peso en kg/m, no el perfil.
    # Insensible a mayusculas porque el modelo tiene L8x7,07 y L8X7,07 conviviendo.
    i = nombre.lower().find('x')
    if i <= 0:
        return nombre
    return nombre[:i].strip()


def nombre_familia(el):
    try:
        return el.Symbol.FamilyName
    except Exception:
        return ''


def excluida(el):
    if not excluidas:
        return False
    n = (nombre_familia(el) + ' ' + nombre_tipo(el)).lower()
    return any(t in n for t in excluidas)


def tipo_de_texto():
    tipos = list(FilteredElementCollector(doc).OfClass(TextNoteType))
    if not tipos:
        log.append('ERROR: el proyecto no tiene ningun tipo de texto.')
        return None
    log.append('Tipos de texto en el proyecto: ' + ', '.join(sorted(elem_name(t) for t in tipos)))
    if tipo_pedido:
        for t in tipos:
            if elem_name(t).strip().lower() == tipo_pedido.strip().lower():
                return t
        # NO se cae al primero de la lista: si el nombre esta mal escrito, rotular
        # decenas de vigas con la fuente de titulos de 5 mm es peor que no rotular.
        log.append('ERROR: no existe el tipo de texto "{}". Corregi el input con uno de la lista de arriba; no se escribio ningun rotulo.'.format(
            tipo_pedido))
        return None
    log.append('AVISO: no se pidio tipo de texto; se usa "{}".'.format(elem_name(tipos[0])))
    return tipos[0]


def alto_de_texto(tt, escala):
    # TEXT_SIZE viene en pies de PAPEL; en el modelo mide eso por la escala de la vista
    try:
        p = tt.get_Parameter(BuiltInParameter.TEXT_SIZE)
        if p is not None:
            return p.AsDouble() * escala
    except Exception:
        pass
    return 0.0082 * escala      # 2.5 mm de papel


_medidas = {}


def medir(texto, view, tt, lejos):
    # ancho real del texto EN UNIDADES DE MODELO para la escala de esta vista. Se mide
    # creando un TextNote de prueba sin rotar (asi el bounding box da el ancho directo),
    # y se borra enseguida. Se cachea por (texto, escala) porque los nombres de tipo se
    # repiten decenas de veces.
    clave = (texto, view.Scale)
    if clave in _medidas:
        return _medidas[clave]
    ancho = None
    try:
        opts = TextNoteOptions(tt.Id)
        opts.HorizontalAlignment = HorizontalTextAlignment.Left
        opts.Rotation = 0.0
        tn = TextNote.Create(doc, view.Id, lejos, texto, opts)
        doc.Regenerate()
        bb = tn.get_BoundingBox(view)
        if bb is not None:
            ancho = bb.Max.X - bb.Min.X
        doc.Delete(tn.Id)
    except Exception:
        ancho = None
    if ancho is None or ancho <= 0:
        # sin medicion: se estima con un ancho medio de caracter de 0.6 x la altura
        ancho = len(texto) * alto_de_texto(tt, view.Scale) * 0.6
    _medidas[clave] = ancho
    return ancho


def eje_en_planta(el):
    try:
        loc = el.Location
        c = loc.Curve if (loc is not None and hasattr(loc, 'Curve')) else None
    except Exception:
        c = None
    if c is None or not isinstance(c, Line):
        return None
    p0 = c.GetEndPoint(0)
    p1 = c.GetEndPoint(1)
    a = XYZ(p0.X, p0.Y, 0.0)
    b = XYZ(p1.X, p1.Y, 0.0)
    if a.DistanceTo(b) < TOL_PLANTA:
        return None
    return a, b


def z_de_vista(v):
    zs = [v.Origin.Z]
    try:
        lv = v.GenLevel
        if lv is not None and abs(lv.ProjectElevation - zs[0]) > 1e-9:
            zs.append(lv.ProjectElevation)
    except Exception:
        pass
    return zs


def rotulos_previos(v, tt_id):
    prev = []
    for tn in FilteredElementCollector(doc, v.Id).OfClass(TextNote):
        try:
            if tn.GetTypeId() == tt_id:
                prev.append(tn.Id)
        except Exception:
            pass
    return prev


# ------------------------------------------------- tags en las elevaciones

def tipo_de_tag(nombre):
    # FamilySymbol de Multi-Category Tag con ese nombre. Se activa si hacia falta:
    # un simbolo no activado no se puede colocar.
    disponibles = []
    elegido = None
    for fs in (FilteredElementCollector(doc).OfClass(FamilySymbol)
               .OfCategory(BuiltInCategory.OST_MultiCategoryTags)):
        n = elem_name(fs)
        disponibles.append(n)
        if n.strip().lower() == nombre.strip().lower():
            elegido = fs
    if elegido is None:
        log.append('ERROR: no existe el tag Multi-Category "{}". Disponibles: {}. No se rotulan las elevaciones.'.format(
            nombre, ', '.join(sorted(set(disponibles))) or '(ninguno)'))
        return None
    try:
        if not elegido.IsActive:
            elegido.Activate()
            doc.Regenerate()
    except Exception as e:
        log.append('AVISO: no se pudo activar el tag "{}": {}'.format(nombre, e))
    return elegido


def eje_de_pieza(el):
    # (punto medio, direccion) de la pieza. Las columnas suelen tener LocationPoint en
    # vez de curva, asi que el plan B es el bbox: su centro y su lado mas largo.
    try:
        loc = el.Location
        c = loc.Curve if (loc is not None and hasattr(loc, 'Curve')) else None
        if c is not None:
            a = c.GetEndPoint(0)
            b = c.GetEndPoint(1)
            if a.DistanceTo(b) > TOL_PLANTA:
                return c.Evaluate(0.5, True), (b - a).Normalize()
    except Exception:
        pass
    try:
        bb = el.get_BoundingBox(None)
        if bb is None:
            return None, None
        medio = XYZ((bb.Min.X + bb.Max.X) / 2.0, (bb.Min.Y + bb.Max.Y) / 2.0,
                    (bb.Min.Z + bb.Max.Z) / 2.0)
        dx = bb.Max.X - bb.Min.X
        dy = bb.Max.Y - bb.Min.Y
        dz = bb.Max.Z - bb.Min.Z
        if dz >= dx and dz >= dy:
            return medio, XYZ(0.0, 0.0, 1.0)
        if dx >= dy:
            return medio, XYZ(1.0, 0.0, 0.0)
        return medio, XYZ(0.0, 1.0, 0.0)
    except Exception:
        return None, None


def tags_previos(v, tipo_id):
    prev = []
    for t in FilteredElementCollector(doc, v.Id).OfClass(IndependentTag):
        try:
            if t.GetTypeId() == tipo_id:
                prev.append(t.Id)
        except Exception:
            pass
    return prev


def rotular_elevacion(v, label, ids_miembros, tag_type, tname):
    # un tag por pieza que este SOBRE el eje de la vista. Una elevacion muestra en
    # profundidad todo lo que entre en el Far Clip - en la vista del modelador son 87
    # vigas - y rotularlas todas seria ilegible: el plano-tipo lleva 10 tags, los del
    # marco que la elevacion documenta.
    prev = tags_previos(v, tag_type.Id)
    if prev:
        if not rehacer:
            log.append('{}: {} ya tiene {} tag(s), se salta.'.format(tname, label, len(prev)))
            return 0, 0
        try:
            doc.Delete(List[ElementId](prev))
        except Exception as e:
            log.append('AVISO {}: no se pudieron borrar los tags previos de {}: {}'.format(
                tname, label, e))
    rd = v.RightDirection
    ud = v.UpDirection
    vd = v.ViewDirection
    esc = v.Scale if v.Scale > 0 else 1
    sep = sep_tag_mm / PIE * esc
    tol = tol_eje_cm / 30.48        # cm -> pies
    piezas = []
    for cat in CATS_ROTULABLES:
        try:
            piezas.extend([e for e in (FilteredElementCollector(doc, v.Id)
                                       .OfCategory(cat).WhereElementIsNotElementType())
                           if e.Id.Value in ids_miembros and not excluida(e)])
        except Exception as e:
            log.append('AVISO {}: no se pudieron listar las piezas de {}: {}'.format(tname, label, e))
    hechos = 0
    lejos_del_eje = 0
    fallidos = 0
    ultimo = None
    for el in piezas:
        medio, d = eje_de_pieza(el)
        if medio is None:
            continue
        if abs((medio - v.Origin).DotProduct(vd)) > tol:
            lejos_del_eje += 1
            continue
        # el tag es una anotacion de la vista: su punto va en el plano de la elevacion
        p = medio.Subtract(vd.Multiply((medio - v.Origin).DotProduct(vd)))
        vertical = abs(d.DotProduct(ud)) > abs(d.DotProduct(rd))
        if vertical:
            # columna: el rotulo va girado y a la izquierda de la pieza
            p = p.Subtract(rd.Multiply(sep))
            orient = TagOrientation.Vertical
        else:
            p = p.Add(ud.Multiply(sep))
            orient = TagOrientation.Horizontal
        try:
            IndependentTag.Create(doc, tag_type.Id, v.Id, Reference(el), False, orient, p)
            hechos += 1
        except Exception as e:
            fallidos += 1
            ultimo = e
    if fallidos:
        log.append('AVISO {}: {} tag(s) no se pudieron colocar en {}: {}'.format(
            tname, fallidos, label, ultimo))
    log.append('OK {}: {} tag(s) en {} sobre {} pieza(s) visibles [{} fuera del eje].'.format(
        tname, hechos, label, len(piezas), lejos_del_eje))
    return hechos, lejos_del_eje


def miembros_recursivos(ai):
    res = []
    pila = [doc.GetElement(mid) for mid in ai.GetMemberIds()]
    vistos = set()
    while pila:
        el = pila.pop()
        if el is None:
            continue
        try:
            eid = el.Id.Value
        except Exception:
            eid = None
        if eid is not None:
            if eid in vistos:
                continue
            vistos.add(eid)
        res.append(el)
        if isinstance(el, FamilyInstance):
            try:
                for sid in el.GetSubComponentIds():
                    pila.append(doc.GetElement(sid))
            except Exception:
                pass
    return res


# ------------------------------------------------------------------ main

by_type = {}
for ai in FilteredElementCollector(doc).OfClass(AssemblyInstance):
    by_type.setdefault(ai.AssemblyTypeName, []).append(ai)

if not by_type:
    log.append('AVISO: no hay ningun Assembly en el modelo; nada que rotular.')

if process_all:
    targets = sorted(by_type.keys())
else:
    tokens = [t.strip().lower() for t in filter_text.split(',') if t.strip()]
    if tokens:
        targets = [n for n in sorted(by_type.keys())
                   if any(tok in n.lower() for tok in tokens)]
    else:
        targets = []
        log.append('ERROR: "Todos" esta en False y el filtro esta vacio.')

views = {}
for v in FilteredElementCollector(doc).OfClass(View):
    if not v.IsTemplate:
        views[elem_name(v)] = v

puestos = 0
cortados = 0
apretados = 0
sin_eje = 0
tags = 0
fuera_eje = 0
fallas = {}


def _resolver_fallas(sender, args):
    try:
        fa = args.GetFailuresAccessor()
        resultado = FailureProcessingResult.Continue
        for f in fa.GetFailureMessages():
            try:
                try:
                    desc = f.GetDescriptionText()
                except Exception:
                    desc = '(sin descripcion)'
                es_aviso = f.GetSeverity() == FailureSeverity.Warning
                clave = '{}: {}'.format('AVISO' if es_aviso else 'ERROR', desc)
                fallas[clave] = fallas.get(clave, 0) + 1
                if es_aviso:
                    fa.DeleteWarning(f)
                    continue
                ids = list(f.GetFailingElementIds())
                if ids:
                    fa.DeleteElements(List[ElementId](ids))
                    resultado = FailureProcessingResult.ProceedWithCommit
                elif f.HasResolutions():
                    fa.ResolveFailure(f)
                    resultado = FailureProcessingResult.ProceedWithCommit
            except Exception:
                pass
        args.SetProcessingResult(resultado)
    except Exception:
        pass


app = doc.Application
app.FailuresProcessing += _resolver_fallas
TransactionManager.Instance.EnsureInTransaction(doc)
try:
    tt = tipo_de_texto() if targets else None
    tag_type = tipo_de_tag(tag_pedido) if (tag_pedido and targets) else None
    for tname in targets:
        if tt is None and tag_type is None:
            break
        ai = by_type[tname][0]
        try:
            ids_miembros = set()
            for el in miembros_recursivos(ai):
                try:
                    ids_miembros.add(el.Id.Value)
                except Exception:
                    pass

            plantas = [(views[n], n[len(tname) + 3:])
                       for n in sorted(k for k in views if k.startswith(tname + SUF_TA))]
            if not plantas:
                log.append('AVISO {}: no existen las plantas T.A. (corre 00_Vistas de assembly).'.format(tname))
            elif tt is None:
                plantas = []      # sin tipo de texto valido no se rotulan las plantas

            for v, label in plantas:
                prev = rotulos_previos(v, tt.Id)
                if prev:
                    if not rehacer:
                        log.append('{}: {} ya tiene {} rotulo(s), se salta.'.format(
                            tname, label, len(prev)))
                        continue
                    try:
                        doc.Delete(List[ElementId](prev))
                    except Exception as e:
                        log.append('AVISO {}: no se pudieron borrar los rotulos previos de {}: {}'.format(
                            tname, label, e))

                esc = v.Scale if v.Scale > 0 else 1
                margen = margen_mm / PIE * esc
                alto = alto_de_texto(tt, esc)
                zs = z_de_vista(v)
                # punto de descarte para los TextNote de medicion, bien fuera del crop
                lejos = XYZ(v.Origin.X + 1.0e5, v.Origin.Y + 1.0e5, zs[0])

                try:
                    vigas = [e for e in (FilteredElementCollector(doc, v.Id)
                                         .OfCategory(BuiltInCategory.OST_StructuralFraming)
                                         .WhereElementIsNotElementType())
                             if e.Id.Value in ids_miembros and not excluida(e)]
                except Exception as e:
                    log.append('ERROR {}: no se pudieron listar las vigas de {}: {}'.format(tname, label, e))
                    continue
                if not vigas:
                    log.append('{}: {} no muestra vigas del assembly; sin rotulos.'.format(tname, label))
                    continue

                hechos = 0
                cortos_vista = 0
                apretados_vista = 0
                for el in vigas:
                    nombre = nombre_tipo(el)
                    if not nombre:
                        continue
                    ejes = eje_en_planta(el)
                    if ejes is None:
                        sin_eje += 1
                        continue
                    a, b = ejes
                    largo = a.DistanceTo(b)
                    disponible = largo - 2.0 * margen

                    corto = acortar(nombre)
                    texto = nombre
                    if medir(nombre, v, tt, lejos) > disponible:
                        texto = corto
                        if corto != nombre:
                            cortos_vista += 1
                        # si ni el corto entra se pone igual: mejor una viga rotulada de
                        # mas que una sin identificar. Queda contado en el log.
                        if medir(corto, v, tt, lejos) > disponible:
                            apretados_vista += 1

                    d = XYZ(b.X - a.X, b.Y - a.Y, 0.0).Normalize()
                    ang = math.atan2(d.Y, d.X)
                    # el texto nunca se lee de cabeza: se normaliza a (-90, 90]
                    if ang > math.pi / 2.0:
                        ang -= math.pi
                    elif ang <= -math.pi / 2.0:
                        ang += math.pi
                    # el origen de un TextNote es el TOPE de la linea, asi que hay que
                    # subirlo media altura para que el texto quede centrado en el eje
                    arriba = XYZ(-math.sin(ang), math.cos(ang), 0.0)
                    medio = XYZ((a.X + b.X) / 2.0, (a.Y + b.Y) / 2.0, 0.0)
                    base = medio.Add(arriba.Multiply(alto / 2.0))

                    creado = False
                    ultimo = None
                    for z in zs:
                        try:
                            opts = TextNoteOptions(tt.Id)
                            opts.HorizontalAlignment = HorizontalTextAlignment.Center
                            opts.Rotation = ang
                            opts.KeepRotatedTextReadable = False
                            TextNote.Create(doc, v.Id, XYZ(base.X, base.Y, z), texto, opts)
                            creado = True
                            break
                        except Exception as e:
                            ultimo = e
                    if creado:
                        hechos += 1
                    elif hechos == 0:
                        log.append('ERROR {}: no se pudo escribir un rotulo en {}: {}'.format(
                            tname, label, ultimo))

                puestos += hechos
                cortados += cortos_vista
                apretados += apretados_vista
                log.append('OK {}: {} rotulo(s) en {} sobre {} viga(s) [{} acortados, {} no entran ni cortos].'.format(
                    tname, hechos, label, len(vigas), cortos_vista, apretados_vista))

            # --- elevaciones de eje: tag en vez de texto ---
            if tag_type is not None:
                elevaciones = [(views[n], n[len(tname) + 3:])
                               for n in sorted(k for k in views if k.startswith(tname + SUF_EJE))]
                if not elevaciones:
                    log.append('AVISO {}: no existen las elevaciones de eje (corre 00_Vistas de assembly).'.format(tname))
                for v, label in elevaciones:
                    try:
                        h, f = rotular_elevacion(v, label, ids_miembros, tag_type, tname)
                        tags += h
                        fuera_eje += f
                    except Exception as e:
                        log.append('ERROR {}: tags en {}: {}'.format(tname, label, e))
        except Exception as e:
            log.append('ERROR {}: {}'.format(tname, e))
finally:
    try:
        TransactionManager.Instance.TransactionTaskDone()
        TransactionManager.Instance.ForceCloseTransaction()
    finally:
        app.FailuresProcessing -= _resolver_fallas

if sin_eje:
    log.append('AVISO: {} viga(s) sin curva de ubicacion recta; no se pudieron rotular.'.format(sin_eje))
if fallas:
    log.append('--- mensajes de Revit al comitear ---')
    for clave in sorted(fallas.keys()):
        log.append('{} (x{})'.format(clave, fallas[clave]))

log.insert(0, 'PLANTAS - rotulos escritos: {} | acortados por falta de espacio: {} | no entran ni cortos: {}'.format(
    puestos, cortados, apretados))
log.insert(1, 'ELEVACIONES - tags puestos: {} | piezas salteadas por estar fuera del eje: {}'.format(
    tags, fuera_eje))
log.insert(2, 'Assemblies procesados: {}'.format(len(targets)))
OUT = log
# ----------------------------------------
log = Watch(py_rotulo_de_perfil_sobre_cada)  # graph output
